# Grasshopper definition HilbertCurving.gh (Grasshopper 1.0.7)

crv = Curve(<curve referenced from the Rhino model>)
python = GhPythonScript(crvs=crv)  # -> out, a; inputs crvs: list of Curve
# ---------- python: Python ----------
import os
import sys

file_name = ghenv.Component.OnPingDocument().FilePath

def get_parent(path, degree = 1):
    
    parent = path
    
    for i in range(degree):
        
        parent = os.path.dirname(parent)
        
    return parent
    
path = get_parent(file_name, 3)

sys.path.append(os.path.join(path, 'src') )

from spacemapping_curve.quadtree import *
from spacemapping_curve.distance import FuckYouBernhardFunction
from spacemapping_curve.distance import DistanceToCurve
import spacemapping_curve.hilbertcurve as hc

import Rhino.Geometry as rg
import rhinoscriptsyntax as rs 

reload(hc)

# ==============================================================================
# get distance value
# ==============================================================================

crv_distance = DistanceToCurve(crvs)

# ==============================================================================
# Main
# ==============================================================================

a = hc.draw_hc(200, 7, crv_distance)
# ---------- end python ----------
panel = Panel(python.out)
